# Grasshopper definition ExportOfficeBuilding2STB.gh (Grasshopper 1.0.7)
# plug-ins: Kangaroo2 Components, karambaGH, HoaryFox(karambaConnect)

number_slider = Slider(3.6, range=0..10)
number_slider_2 = Slider(7.2, range=0..10)
number_slider_3 = Slider(6, range=0..10)
number_slider_4 = Slider(1, range=0..10)
pt = ConstructPoint(XCoordinate=0, YCoordinate=number_slider_2, ZCoordinate=0)
xy = XYPlane(Origin=pt)
recgrid = Rectangular(Plane=xy, SizeX=number_slider, SizeY=Slider(3.6, range=0..10), ExtentX=number_slider_3, ExtentY=number_slider_4)  # -> Cells, Points
recgrid_2 = Rectangular(Plane=PlaneXY(0, 0, 0), SizeX=number_slider, SizeY=number_slider_2, ExtentX=number_slider_3, ExtentY=number_slider_4)  # -> Cells, Points
number_slider_5 = Slider(4, range=0..10)
number_slider_6 = Slider(6, range=0..10)
explode = Explode(Curve=flatten([recgrid_2.Cells, recgrid.Cells]), Recursive=True)  # -> flatten(Segments), flatten(Vertices)
duppt = RemoveDuplicatePts(Points=explode.Vertices, Tolerance=0.01)
# Create base model to input karamba
dupln = RemoveDuplicateLines(Lines=explode.Segments, Tolerance=0.01)
Z = UnitZ(Factor=number_slider_5)

# ---- group: Brace CrossSection
number_slider_7 = Slider(30, range=0..100)
number_slider_8 = Slider(1.5, range=0..2)
matselect = MaterialSelectionKaramba3D(Color=ColourSwatch(SwatchColor=RGB(39, 168, 0)), menu=[dropdown(1), dropdown(1)])
cross_section = CrossSectionKaramba3D(
    FamilyNameOfCrossSection="DefaultCroSec",
    NameOfCrossSection="H-300x300x10x15",
    Material=matselect,
    Height_cm=number_slider_7,
    UpperFlangeWidth_cm=number_slider_7,
    LowerFlangeWidth_cm=number_slider_7,
    UpperFlangeThickness_cm=number_slider_8,
    LowerFlangeThickness_cm=number_slider_8,
    WebThickness_cm=Slider(1, range=0..2),
    FilletRadius_cm=0,
    mode="I")

# ---- group: FGirder CrossSection
number_slider_9 = Slider(60, range=0..100)
# In order to identify each cross section in the STB data,
# you need to set a cross section name, such as BD-300x500.
swatch = ColourSwatch(SwatchColor=RGB(138, 138, 138))
# CrossSection Settings
panel = Panel("BD-600x1800")
matselect_2 = MaterialSelectionKaramba3D(Color=swatch, menu=[dropdown(3), dropdown(1)])
cross_section_2 = CrossSectionKaramba3D(
    FamilyNameOfCrossSection="DefaultCroSec",
    NameOfCrossSection=panel,
    Material=matselect_2,
    Height_cm=Slider(160, range=0..200),
    UpperFlangeWidth_cm=number_slider_9,
    LowerFlangeWidth_cm=number_slider_9,
    mode="Trapezoid")

# ---- group: Girder CrossSection
number_slider_10 = Slider(2.8, range=0..10)
number_slider_11 = Slider(35, range=0..100)
matselect_3 = MaterialSelectionKaramba3D(Color=ColourSwatch(SwatchColor=RGB(255, 48, 48)), menu=[dropdown(1), dropdown(1)])
cross_section_3 = CrossSectionKaramba3D(
    FamilyNameOfCrossSection="DefaultCroSec",
    NameOfCrossSection="H-700x350x16x28",
    Material=matselect_3,
    Height_cm=Slider(70, range=0..100),
    UpperFlangeWidth_cm=number_slider_11,
    LowerFlangeWidth_cm=number_slider_11,
    UpperFlangeThickness_cm=number_slider_10,
    LowerFlangeThickness_cm=number_slider_10,
    WebThickness_cm=Slider(1.6, range=0..10),
    FilletRadius_cm=Slider(0.8, range=0..1),
    mode="I")

# ---- group: Column CrossSection
number_slider_12 = Slider(2.5, range=0..10)
number_slider_13 = Slider(50, range=0..100)
matselect_4 = MaterialSelectionKaramba3D(Color=ColourSwatch(SwatchColor=RGB(48, 169, 255)), menu=[dropdown(1), dropdown(1)])
multiplication = Multiplication(A=number_slider_12, B=3.5)
cross_section_4 = CrossSectionKaramba3D(
    FamilyNameOfCrossSection="DefaultCroSec",
    NameOfCrossSection="BOX-500x25",
    Material=matselect_4,
    Height_cm=number_slider_13,
    UpperFlangeWidth_cm=number_slider_13,
    LowerFlangeWidth_cm=number_slider_13,
    UpperFlangeThickness_cm=number_slider_12,
    LowerFlangeThickness_cm=number_slider_12,
    SidewallsThickness_cm=number_slider_12,
    FilletRadius_cm=multiplication,
    mode="Box")

# ----
line = LineSDL(Start=duppt, Direction=Z, Length=number_slider_5)
arrlinear = LinearArray(Geometry=line, Direction=Z, Count=expr("x-1", number_slider_6))  # -> Geometry, Transform
arrlinear_2 = LinearArray(Geometry=dupln, Direction=Z, Count=number_slider_6)  # -> Geometry, Transform
branch = TreeBranch(Tree=arrlinear.Geometry, Path=["{0;0;2}", "{0;0;16}"], MaintainPaths=True)
branch_2 = TreeBranch(Tree=arrlinear.Geometry, Path=["{0;0;4}", "{0;0;17}"], MaintainPaths=True)
flip = FlipMatrix(Data=arrlinear_2.Geometry)
end = EndPoints(Curve=branch_2)  # -> Start, End
end_2 = EndPoints(Curve=branch)  # -> Start, End
bang = ExplodeTree(Data=flip)  # -> Branch0, Branch1, Branch2, Branch3, Branch4, Branch5
ln = Line(StartPoint=end_2.Start, EndPoint=end.End)

# ---- group: Column
line_2 = Line(flatten(arrlinear.Geometry))

# ---- group: Girder
line_3 = Line(flatten([bang.Branch1, bang.Branch2, bang.Branch3, bang.Branch4, bang.Branch5]))

# ---- group: Brace
line_4 = Line(flatten(ln))

# ---- group: FGirder
line_5 = Line(bang.Branch0)

# ----
# If you want  to be treated as brace in STB,
# set it truss element (Bending to false)
panel_2 = Panel("""true
true
true
false""")
graft = GraftTree(Tree=panel_2, IncludeEmptyLists=True, IncludeNullItems=True)

entwine = Entwine(Branch00=cross_section_2, Branch01=cross_section_4, Branch02=cross_section_3, Branch03=cross_section, FlattenInputs=True)
entwine_2 = Entwine(Branch00=line_5, Branch01=line_2, Branch02=line_3, Branch03=line_4, FlattenInputs=True)
panel_3 = Panel("""FGirder
Column
Girder
Brace""")
graft_2 = GraftTree(Tree=panel_3, IncludeEmptyLists=True, IncludeNullItems=True)

# ---- group: Karamba
supp = SupportKaramba3D(PosInd=duppt, menu=[buttons(on, on, on, off, off, off)])
linetobeam = LineToBeamKaramba3D(Line=entwine_2, Identifier=graft_2, CrossSection=entwine, New=True, Remove=True, LimitDistance_m=0.005, Bending=graft)  # -> flatten(Element), Points, Info
loads = LoadsKaramba3D(Vector=Vector(0, 0, -1), LCase=0, mode="Gravity")
# You don't necessarily have to do the analysis,
# the output of the AssmebleModel component is fine.
assemble = AssembleModelKaramba3D(Elem=linetobeam.Element, Support=supp, Load=loads, LimitDistance_m=0.005)  # -> Model, Info, Mass_kg, CenterOfGravity
analyze = AnalyzeKaramba3D(Model=assemble.Model)  # -> CalculatedModel, MaximumDisplacement_cm, ResultingForceOfGravity_kN, ElasticEnergy_kNm
modelview = ModelViewKaramba3D(Model=analyze.CalculatedModel, ResultFactors=1, ResultCase=-1)  # -> Model, DeformedMesh, DeformedAxes, DeformedModel
beamview = BeamViewKaramba3D(Model=modelview.Model)  # -> Model, MeshesOfRenderedBeams, DeformedBeamAxes, LegendColors, LegendTags
model = ModelKaramba3D(assemble.Model)

# ----
nodebuilder = NodeBuilder(Model=model)

# ----
# The distinction between columns and girder is
# calculated using the angle(radian) inputed in Angle.
# The results are displayed as text in Rhino's viewport.
panel_4 = Panel("pi/4")
frame_by_angle = FrameBuilderByAngle(Model=model, Angle=panel_4)  # -> Member, Section

# ---- group: Export Karamba to ST-Bridge / Build Story Data
panel_5 = Panel("""1F
RF""")
panel_6 = Panel("""0
3000""")
panel_7 = Panel("""100
100""")
story = StoryBuilder(Node=nodebuilder, Height=panel_6, Range=panel_7, Name=panel_5)

# ---- group: Export Karamba to ST-Bridge / Build Axis Data
panel_8 = Panel("""100
100
100
100""")
# Create ST-Bridge File using Karamba3D
panel_9 = Panel("""0
4000
0
4000""")
panel_10 = Panel("""X1
X2
Y1
Y2""")
panel_11 = Panel("""0
0
1
1""")
axis = AxisBuilder(Node=nodebuilder, Distance=panel_9, Range=panel_8, Name=panel_10, Direction=panel_11)

# ---- group: Export Karamba to ST-Bridge
# ↓ The panel gives you an overview of
#     the contents of the conversion to STB.
# ↑ Press the button to output stb file
# The default output path is desktop.
button = Button()
panel_12 = Panel(story)
panel_13 = Panel(axis)
export = ExportSTBFile(
    Node=nodebuilder,
    Axis=axis,
    Story=story,
    Member=frame_by_angle.Member,
    Section=frame_by_angle.Section,
    Path="C:\Users\hiroa\Desktop\model.stb",
    Out=button)
panel_14 = Panel(export)
