# Grasshopper definition ExportSTB.gh (Grasshopper 1.0.7)
# plug-ins: karambaGH, HoaryFox(karambaConnect)

pt = Point(Point(0, 0, 0))
pt_2 = Point(Point(4, 4, 0))
# Create base model to input karamba
rec_2pt = Rectangle2Pt(Plane=PlaneXY(0, 0, 0), PointA=pt, PointB=pt_2, Radius=0)  # -> Rectangle, Length
# CrossSection Settings
Z = UnitZ(Factor=Slider(3, range=0..10))
explode = Explode(Curve=rec_2pt.Rectangle, Recursive=True)  # -> Segments, Vertices
move = Move(Geometry=explode.Segments, Motion=Z)  # -> Geometry, Transform
end = EndPoints(Curve=explode.Segments)  # -> Start, End
Z_2 = UnitZ(Factor=1)
line = LineSDL(Start=end.Start, Direction=Z_2, Length=Slider(3, range=0..10))

# ---- group: FGirder CrossSection
number_slider = Slider(30, range=0..100)
# In order to identify each cross section in the STB data,
# you need to set a cross section name, such as BD-300x500.
panel = Panel("BD-300x500")
matselect = MaterialSelectionKaramba3D(Color=ColourSwatch(SwatchColor=RGB(138, 138, 138)), menu=[dropdown(3), dropdown(1)])
cross_section = CrossSectionKaramba3D(
    FamilyNameOfCrossSection="DefaultCroSec",
    NameOfCrossSection=panel,
    Material=matselect,
    Height_cm=Slider(50, range=0..100),
    UpperFlangeWidth_cm=number_slider,
    LowerFlangeWidth_cm=number_slider,
    mode="Trapezoid")

# ---- group: Column CrossSection
number_slider_2 = Slider(1.6, range=0..10)
number_slider_3 = Slider(30, range=0..100)
matselect_2 = MaterialSelectionKaramba3D(Color=ColourSwatch(SwatchColor=RGB(48, 169, 255)), menu=[dropdown(1), dropdown(1)])
cross_section_2 = CrossSectionKaramba3D(
    FamilyNameOfCrossSection="DefaultCroSec",
    NameOfCrossSection="BOX-300x16",
    Material=matselect_2,
    Height_cm=number_slider_3,
    UpperFlangeWidth_cm=number_slider_3,
    LowerFlangeWidth_cm=number_slider_3,
    UpperFlangeThickness_cm=number_slider_2,
    LowerFlangeThickness_cm=number_slider_2,
    SidewallsThickness_cm=number_slider_2,
    FilletRadius_cm=0.6,
    mode="Box")

# ---- group: Girder CrossSection
number_slider_4 = Slider(1.3, range=0..10)
number_slider_5 = Slider(20, range=0..100)
matselect_3 = MaterialSelectionKaramba3D(Color=ColourSwatch(SwatchColor=RGB(255, 48, 48)), menu=[dropdown(1), dropdown(1)])
cross_section_3 = CrossSectionKaramba3D(
    FamilyNameOfCrossSection="DefaultCroSec",
    NameOfCrossSection="H-400x200x8x13",
    Material=matselect_3,
    Height_cm=Slider(40, range=0..100),
    UpperFlangeWidth_cm=number_slider_5,
    LowerFlangeWidth_cm=number_slider_5,
    UpperFlangeThickness_cm=number_slider_4,
    LowerFlangeThickness_cm=number_slider_4,
    WebThickness_cm=0.5,
    FilletRadius_cm=Slider(0.8, range=0..1),
    mode="I")

# ---- group: Column
line_2 = Line(line)

# ---- group: Girder
line_3 = Line(move.Geometry)

# ---- group: FGirder
line_4 = Line(explode.Segments)

# ----
entwine = Entwine(Branch00=cross_section, Branch01=cross_section_2, Branch02=cross_section_3, FlattenInputs=True)
entwine_2 = Entwine(Branch00=line_4, Branch01=line_2, Branch02=line_3, FlattenInputs=True)
panel_2 = Panel("""FGirder
Column
Girder""")

# ---- group: Karamba
supp = SupportKaramba3D(PosInd=end.Start, menu=[buttons(on, on, on, off, off, off)])
linetobeam = LineToBeamKaramba3D(Line=entwine_2, Identifier=panel_2, CrossSection=entwine, New=True, Remove=True, LimitDistance_m=0.005)  # -> flatten(Element), Points, Info
loads = LoadsKaramba3D(Vector=Vector(0, 0, -1), LCase=0, mode="Gravity")
# Create & Analyze Karamba model
# You don't necessarily have to do the analysis,
# the output of the AssmebleModel component is fine.
assemble = AssembleModelKaramba3D(Elem=linetobeam.Element, Support=supp, Load=loads, LimitDistance_m=0.005)  # -> Model, Info, Mass_kg, CenterOfGravity
analyze = AnalyzeKaramba3D(Model=assemble.Model)  # -> CalculatedModel, MaximumDisplacement_cm, ResultingForceOfGravity_kN, ElasticEnergy_kNm
modelview = ModelViewKaramba3D(Model=analyze.CalculatedModel, ResultFactors=1, ResultCase=-1)  # -> Model, DeformedMesh, DeformedAxes, DeformedModel
beamview = BeamViewKaramba3D(Model=modelview.Model)  # -> Model, MeshesOfRenderedBeams, DeformedBeamAxes, LegendColors, LegendTags

# ---- group: Export Karamba to ST-Bridge
framebuilder = FrameBuilderUsingKaramba(Model=beamview.Model)  # -> Node, Member, Section
# ↑ Press the button to output stb file
# The default output path is desktop.
button = Button()

# ---- group: Export Karamba to ST-Bridge / Build Story Data
panel_3 = Panel("""1F
RF""")
panel_4 = Panel("""0
3000""")
panel_5 = Panel("""100
100""")
story = StoryBuilder(Node=framebuilder.Node, Height=panel_4, Range=panel_5, Name=panel_3)

# ---- group: Export Karamba to ST-Bridge / Build Axis Data
panel_6 = Panel("""100
100
100
100""")
panel_7 = Panel("""X1
X2
Y1
Y2""")
panel_8 = Panel("""0
0
1
1""")
# Create ST-Bridge File using Karamba
panel_9 = Panel("""0
4000
0
4000""")
axis = AxisBuilder(Node=framebuilder.Node, Distance=panel_9, Range=panel_6, Name=panel_7, Direction=panel_8)

# ---- group: Export Karamba to ST-Bridge (continued)
panel_10 = Panel(story)
# ↓ The panel gives you an overview of
#     the contents of the conversion to STB.
panel_11 = Panel(axis)
export = ExportSTBFile(
    Node=framebuilder.Node,
    Axis=axis,
    Story=story,
    Member=framebuilder.Member,
    Section=framebuilder.Section,
    Path="C:\Users\hiroa\Desktop\model.stb",
    Out=button)
panel_12 = Panel(export)
